# Grasshopper definition KUKA_Zivid_Bridge.gh (Grasshopper 1.0.8)

trigger = Trigger(Interval=1000, TimerInterval=1000, Target=python_3_script_4)  # disabled

# ----
# Capture Client
boolean_toggle = BooleanToggle(True)
python_3_script = Python3Script(baseUrl="http://127.0.0.1:8765", capture=boolean_toggle)  # -> ok, captureId, pointCount, previewCount, previewPath, plyPath, matrix, info; inputs capture: Boolean
# ---------- python_3_script: Python ----------
import json
import urllib.request
import scriptcontext as sc


ok = False
captureId = None
pointCount = 0
previewCount = 0
previewPath = None
plyPath = None
matrix = None
info = ""

if not baseUrl:
    baseUrl = "http://127.0.0.1:8765"


# ------------------------------------------------
# Button rising-edge detection
# 避免 GH recompute 時重複 Capture
# ------------------------------------------------

key = "CAPTURE_BUTTON_" + str(ghenv.Component.InstanceGuid)

previous = sc.sticky.get(key, False)
current = bool(capture)

trigger = current and not previous

sc.sticky[key] = current


# ------------------------------------------------
# CAPTURE
# ------------------------------------------------

if trigger:

    try:

        url = baseUrl.rstrip("/") + "/capture"

        request = urllib.request.Request(
            url,
            method="POST"
        )

        with urllib.request.urlopen(
            request,
            timeout=120.0
        ) as response:

            text = response.read().decode("utf-8")

        data = json.loads(text)

        ok = bool(data.get("ok", False))

        captureId = data.get("capture_id")

        pointCount = data.get(
            "point_count",
            0
        )

        previewCount = data.get(
            "preview_point_count",
            0
        )

        matrix = data.get(
            "T_base_camera"
        )

        files = data.get(
            "files",
            {}
        )

        previewPath = files.get(
            "preview_xyz"
        )

        plyPath = files.get(
            "ply"
        )

        info = data.get(
            "message",
            "Capture complete"
        )

    except Exception as e:

        ok = False
        info = str(e)
# ---------- end python_3_script ----------
cluster = Cluster(text=[python_3_script.previewPath, python_3_script.plyPath])
panel = Panel([python_3_script.ok, python_3_script.captureId, python_3_script.pointCount, python_3_script.previewCount, python_3_script.info])
panel_2 = Panel(cluster)

command = ValueList({"Add Calibration Sample": ADD_SAMPLE, "Solve Calibration": SOLVE, "Capture": CAPTURE, "Reset Calibration": RESET, "Compute WCS": WCS}, selected="Capture")  # disabled

# ----
# Robot Status
trigger_2 = Trigger(Interval=1000, TimerInterval=1000, Target=python_3_script_2)
python_3_script_2 = Python3Script(baseUrl="http://127.0.0.1:8765")  # -> service, connected, valid, stationary, age, seq, plane, info; inputs baseUrl: String
# ---------- python_3_script_2: Python ----------
import json
import urllib.request
import Rhino.Geometry as rg

service = None
connected = False
valid = False
stationary = False
age = None
seq = None
plane = None
info = ""

if not baseUrl:
    baseUrl = "http://127.0.0.1:8765"

try:
    url = baseUrl.rstrip("/") + "/status"

    with urllib.request.urlopen(url, timeout=1.0) as response:
        text = response.read().decode("utf-8")

    data = json.loads(text)

    service = data.get("service")

    robot = data.get("robot", {})

    connected = bool(robot.get("connected", False))
    valid = bool(robot.get("pose_valid", False))
    stationary = bool(robot.get("stationary", False))
    age = robot.get("pose_age_ms")
    seq = robot.get("seq")

    T = robot.get("T_base_flange")

    if T:
        # Translation
        origin = rg.Point3d(
            float(T[0][3]),
            float(T[1][3]),
            float(T[2][3])
        )

        # Rotation matrix columns = local axes
        xaxis = rg.Vector3d(
            float(T[0][0]),
            float(T[1][0]),
            float(T[2][0])
        )

        yaxis = rg.Vector3d(
            float(T[0][1]),
            float(T[1][1]),
            float(T[2][1])
        )

        plane = rg.Plane(
            origin,
            xaxis,
            yaxis
        )

    if connected and valid:
        info = "Robot UDP OK"
    else:
        info = "Robot UDP unavailable / stale"

except Exception as e:
    info = str(e)
# ---------- end python_3_script_2 ----------
panel_3 = Panel([python_3_script_2.service, python_3_script_2.connected, python_3_script_2.valid, python_3_script_2.stationary, python_3_script_2.age, python_3_script_2.seq])
panel_4 = Panel(python_3_script_2.info)
plane = Plane(python_3_script_2.plane)
symbol_simple = SymbolSimple(Style=13, Size=15, Rotation=0, Colour=RGB(255, 0, 0))
panel_5 = Panel(plane)

number_slider = Slider(50000, range=20000..50000)  # disabled
button = Button()  # disabled

# ----
# Load Preview
boolean_toggle_2 = BooleanToggle(True)
python_3_script_3 = Python3Script(path=python_3_script.previewPath, load=boolean_toggle_2)  # -> points, count, info; inputs load: Boolean, maxPoints: Int32
# ---------- python_3_script_3: Python ----------
import os
import Rhino.Geometry as rg
import math


points = []
count = 0
info = ""


if maxPoints is None:
    maxPoints = 10000


if load and path:

    try:

        if not os.path.isfile(path):

            info = "File not found:\n{}".format(path)

        else:

            result = []

            with open(
                path,
                "r",
                encoding="utf-8"
            ) as f:

                for line in f:

                    if len(result) >= int(maxPoints):
                        break

                    line = line.strip()

                    if not line:
                        continue

                    values = line.split()

                    if len(values) < 3:
                        continue

                    x = float(values[0])
                    y = float(values[1])
                    z = float(values[2])

                    if not (
                        math.isfinite(x)
                        and math.isfinite(y)
                        and math.isfinite(z)
                    ):
                        continue

                    result.append(
                        rg.Point3d(
                            x,
                            y,
                            z
                        )
                    )

            points = result

            count = len(points)

            info = "Loaded {} points".format(
                count
            )

    except Exception as e:

        points = []
        count = 0
        info = str(e)
# ---------- end python_3_script_3 ----------

file_path = FilePath("C:\Users\Sing\Desktop\NYCU MS\MS Y2 115-A\機器人視覺 X 木構\20260803test\0000.ply")  # disabled
python_3_script_4 = Python3Script(baseUrl="http://127.0.0.1:8765")  # -> service, robotConnected, robotStationary, poseAge, robotAge, cameraConnected, samples, calibrated, lastCapture, raw; inputs baseUrl: String; disabled
# ---------- python_3_script_4: Python ----------
import json
import urllib.request

service = None
robotConnected = False
robotStationary = False
poseAge = None
robotPose = None
cameraConnected = False
samples = 0
calibrated = False
lastCapture = None
raw = None

if not baseUrl:
    baseUrl = "http://127.0.0.1:8765"

try:
    url = baseUrl.rstrip("/") + "/status"

    with urllib.request.urlopen(url, timeout=1.0) as response:
        text = response.read().decode("utf-8")
        data = json.loads(text)

    raw = json.dumps(data, indent=2)

    service = data.get("service")

    robot = data.get("robot", {})
    robotConnected = robot.get("connected", False)
    robotStationary = robot.get("stationary", False)
    poseAge = robot.get("pose_age_ms")
    robotPose = robot.get("raw_pose")

    camera = data.get("camera", {})
    cameraConnected = camera.get("connected", False)

    calibration = data.get("calibration", {})
    samples = calibration.get("sample_count", 0)
    calibrated = calibration.get("solved", False)

    capture = data.get("capture", {})
    lastCapture = capture.get("last_capture_id")

except Exception as e:
    service = "OFFLINE"
    raw = str(e)
# ---------- end python_3_script_4 ----------
button_2 = Button()  # disabled
python_3_script_5 = Python3Script(baseUrl="http://127.0.0.1:8765", command=command, send=button)  # -> ok, message, response; inputs send: Boolean; disabled
# ---------- python_3_script_5: Python ----------
import json
import urllib.request
import scriptcontext as sc

if not baseUrl:
    baseUrl = "http://127.0.0.1:8765"

ok = False
message = ""
response = None

key = "ROBOT_VISION_COMMAND_" + str(ghenv.Component.InstanceGuid)

previous = sc.sticky.get(key, False)
current = bool(send)

# Rising edge only
trigger = current and not previous
sc.sticky[key] = current

endpoint_map = {
    "ADD_SAMPLE": "/calibration/sample",
    "SOLVE": "/calibration/solve",
    "CAPTURE": "/capture",
    "RESET": "/calibration/reset",
    "WCS": "/wcs/compute",
}

if trigger:

    endpoint = endpoint_map.get(str(command).upper())

    if endpoint is None:
        message = "Unknown command: {}".format(command)

    else:
        try:
            url = baseUrl.rstrip("/") + endpoint

            request = urllib.request.Request(
                url,
                data=b"{}",
                headers={
                    "Content-Type": "application/json"
                },
                method="POST"
            )

            with urllib.request.urlopen(
                request,
                timeout=120.0
            ) as r:

                text = r.read().decode("utf-8")
                data = json.loads(text)

            response = json.dumps(data, indent=2)

            ok = bool(data.get("ok", True))

            message = data.get(
                "message",
                "Command completed"
            )

        except Exception as e:
            ok = False
            message = str(e)
# ---------- end python_3_script_5 ----------
python_3_script_6 = Python3Script(path=file_path, load=button_2, maxPoints=number_slider)  # -> points, count, info; inputs load: Boolean, maxPoints: Int32; disabled
# ---------- python_3_script_6: Python ----------
import os
import Rhino.Geometry as rg

points = []
count = 0
info = ""

if maxPoints is None:
    maxPoints = 50000

if load and path:

    if not os.path.isfile(path):
        info = "File not found: " + str(path)

    else:
        try:
            pts = []

            with open(path, "r") as f:

                for line in f:

                    if len(pts) >= int(maxPoints):
                        break

                    line = line.strip()

                    if not line:
                        continue

                    values = line.split()

                    if len(values) < 3:
                        continue

                    x = float(values[0])
                    y = float(values[1])
                    z = float(values[2])

                    pts.append(
                        rg.Point3d(x, y, z)
                    )

            points = pts
            count = len(points)

            info = "Loaded {} preview points".format(count)

        except Exception as e:

            points = []
            count = 0
            info = str(e)
# ---------- end python_3_script_6 ----------
panel_6 = Panel(python_3_script_4.robotAge)  # disabled
panel_7 = Panel([python_3_script_4.cameraConnected, python_3_script_4.samples, python_3_script_4.calibrated])  # disabled
panel_8 = Panel([python_3_script_4.service, python_3_script_4.robotConnected, python_3_script_4.robotStationary, python_3_script_4.poseAge])
panel_9 = Panel([python_3_script_5.ok, python_3_script_5.message, python_3_script_5.response])  # disabled
panel_10 = Panel(python_3_script_4.raw)  # disabled
point_cloud_attributes = PointCloudAttributes(Cloud=python_3_script_3.points)  # -> Cloud, Locations, Normals, Colours, Hidden
symbol_display = SymbolDisplay(Location=plane, Display=symbol_simple)

# ==== cluster Cluster
text = ClusterInput()
panel = Panel(""" /
\
""")
text_split = TextSplit(Text=text, Separators=panel)
list_item = ListItem(List=text_split, Index=-1, Wrap=True)  # -> flatten(Item)
i = ClusterOutput(list_item)
